# Grasshopper definition finalcrossfile.gh (Grasshopper 1.0.7)

point = Point(<point referenced from the Rhino model>)
point_2 = Point(<point referenced from the Rhino model>)
point_3 = Point(<point referenced from the Rhino model>)
point_4 = Point(<point referenced from the Rhino model>)
point_5 = Point(<point referenced from the Rhino model>)
point_6 = Point(<point referenced from the Rhino model>)
point_7 = Point(<point referenced from the Rhino model>)
point_8 = Point(<point referenced from the Rhino model>)
line = Line(StartPoint=point, EndPoint=point_2)
line_2 = Line(StartPoint=point_7, EndPoint=point_2)
line_3 = Line(StartPoint=point_5, EndPoint=point_3)
line_4 = Line(StartPoint=point_4, EndPoint=point_3)
line_5 = Line(StartPoint=point_8, EndPoint=point_7)
line_6 = Line(StartPoint=point_6, EndPoint=point_4)
line_7 = Line(StartPoint=point_6, EndPoint=point_5)
line_8 = Line(StartPoint=point, EndPoint=point_8)
curve = Curve(line)
curve_2 = Curve(line_4)
curve_3 = Curve(line_7)
curve_4 = Curve(line_2)
curve_5 = Curve(line_3)
curve_6 = Curve(line_6)
curve_7 = Curve(line_8)
curve_8 = Curve(line_5)
