# Grasshopper definition fixedassignemt 2 (1).gh (Grasshopper 1.0.7)

# This part manipuliates the number of sides and the size of the shape
point = Point(Point(0.001474888729, 0, 0))
# These numbers mainpulate the length of the vector that cuts out pieces from the shape
number_slider = Slider(0.2, range=0..2.2)
polygon = Polygon(Plane=point, Radius=Slider(3, range=0..10), Segments=Slider(4, range=0..10), FilletRadius=0)  # -> Polygon, Length
deconstruct_brep = DeconstructBrep(Brep=polygon.Polygon)  # -> Faces, Edges, Vertices
length = Length(Curve=deconstruct_brep.Edges)
addition = Addition(A=Slider(0.6, range=0..10), B=Slider(1, range=0..1))
curve_middle = CurveMiddle(Curve=deconstruct_brep.Edges)
curve = Curve(deconstruct_brep.Edges)
division = Division(A=number_slider, B=length)
boolean_toggle = BooleanToggle(True)
vector_2pt = Vector2Pt(PointA=point, PointB=curve_middle, Unitize=boolean_toggle)  # -> Vector, Length
scale = Scale(Geometry=curve, Center=curve_middle, Factor=division)  # -> Geometry, Transform
vector_2pt_2 = Vector2Pt(PointA=curve_middle, PointB=point, Unitize=boolean_toggle)  # -> Vector, Length
amplitude = Amplitude(Vector=vector_2pt_2.Vector, Amplitude=addition)
curve_2 = Curve(polygon.Polygon)
extrude = Extrude(Base=scale.Geometry, Direction=amplitude)
move = Move(Geometry=extrude, Motion=vector_2pt.Vector)  # -> Geometry, Transform
# These part were needed to be baked
trim_with_regions = TrimWithRegions(Curve=curve_2, Regions=move.Geometry)  # -> Inside, Outside
trim_with_regions_2 = TrimWithRegions(Curve=move.Geometry, Regions=curve_2)  # -> Inside, Outside
curve_3 = Curve(trim_with_regions.Inside)
curve_4 = Curve(trim_with_regions.Outside)
curve_5 = Curve(trim_with_regions_2.Inside)
curve_6 = Curve(trim_with_regions_2.Outside)
